# Grasshopper definition loveform.gh (Grasshopper 1.0.7)
# plug-ins: Pufferfish, MosquitoAudio2, EdiTree

# ----
# Play audio file and draw waveform
toggle = BooleanToggle(False)
path = FilePath("D:\waveforms\loveform\audio\i-love-you-1.mp3")
play = AudioPlay(AudioFile=path, Boolean=toggle)
audiowave = AudioWave(AudioFile=path, XOffset=Slider(0.1, range=0..0.25), Skip=Slider(500, range=250..700))  # -> Peak, Points, Length
intcrv = Interpolate(Vertices=audiowave.Points, Degree=3, Periodic=False, KnotStyle=1)  # -> Curve, Length, Domain

# ----
# Divide waveform and sweep to form cup
number_slider = Slider(1.5, range=0..10)
number_slider_2 = Slider(4, range=0..100)
number_slider_3 = Slider(0.1, range=0..1)
number_slider_4 = Slider(25, range=0..100)
split = SplitList(List=audiowave.Points, Index=Slider(175, range=0..9500))  # -> ListA, ListB
split_2 = SplitList(List=split.ListA, Index=Slider(120, range=0..9500))  # -> ListA, ListB
dom = ConstructDomain(DomainStart=0, DomainEnd=expr("x-1", number_slider_2))
range = Range(Domain=dom, Steps=expr("x-1", number_slider_2))
divide_list = DivideList(List=split_2.ListB, Number=number_slider_2)  # -> Chunk, Remainder
vec = VectorXYZ(XComponent=expr("(x*-1)+0.01", graft(0)), YComponent=graft(range), ZComponent=0)  # -> Vector, Length
intcrv_2 = Interpolate(Vertices=divide_list.Chunk, Degree=3, Periodic=False, KnotStyle=1)  # -> Curve, Length, Domain
dom_2 = ConstructDomain(DomainStart=Slider(0, range=0..360), DomainEnd=Slider(270, range=0..360))
move = Move(Geometry=intcrv_2.Curve, Motion=vec.Vector)  # -> Geometry, Transform
movetoplane = MoveToPlane(Geometry=move.Geometry, Plane=PlaneYZ(0, 0, 0), Above=True, Below=True)  # -> Geometry, Transform
range_2 = Range(Domain=dom_2, Steps=Slider(3, range=0..12))
crv = Curve(movetoplane.Geometry)
scale_nu = ScaleNU(Geometry=crv, Plane=PlaneXY(0, 0, 0), ScaleX=1, ScaleY=1, ScaleZ=number_slider)  # -> Geometry, Transform
rotate = Rotate(Geometry=scale_nu.Geometry, Angle=degrees(90), Plane=PlaneXZ(0, 0, 0))  # -> Geometry, Transform
scale = Scale(Geometry=rotate.Geometry, Center=Point(0, 0, 0), Factor=Slider(2, range=0..10))  # -> Geometry, Transform
x_tremez = Extremes(Curve=scale.Geometry, Plane=PlaneXY(0, 0, 0))  # -> Highest, Lowest
move2pt = Move2Pt(
    Geometry=graft(scale.Geometry),
    PointA=graft(x_tremez.Lowest),
    PointB=graft([Point(1, 0, 0), Point(0, 1, 0), Point(-1, 0, 0), Point(0, -1, 0)]))  # -> Moved, Vector, Transform
rotate_2 = Rotate(
    Geometry=flatten(move2pt.Moved),
    Angle=flatten(degrees(range_2)),
    Plane=[PlaneXY(1, 0, 0), PlaneXY(0, 1, 0), PlaneXY(-1, 0, 0), PlaneXY(0, -1, 0)])  # -> Geometry, Transform
circle = CircleCNR(Center=Point(0, 0, 0), Normal=Vector(0, 0, 1), Radius=1)
swp1 = Sweep1(Rail=circle, Sections=flatten(rotate_2.Geometry), Miter=1)
offsrf = OffsetSurface(Surface=circle, Distance=expr("x*-1", number_slider_3), BothSides=False, CreateSolid=True)
offsrf_2 = OffsetSurface(Surface=swp1, Distance=expr("x*-1", number_slider_3), BothSides=False, CreateSolid=True)
scale_2 = Scale(Geometry=offsrf_2, Center=Point(0, 0, 0), Factor=number_slider_4)  # -> Geometry, Transform
scale_3 = Scale(Geometry=offsrf, Center=Point(0, 0, 0), Factor=number_slider_4)  # -> Geometry, Transform
