# Grasshopper definition dystopianform-2.gh (Grasshopper 1.0.7)
# plug-ins: MosquitoAudio2, EdiTree

# ----
# Play audio file and draw waveform
number_slider = Slider(0.4, range=0..0.5)
path = FilePath("C:\Users\baharmon\Downloads\poemform\audio\diamonds-in-dystopia-1.mp3")
play = AudioPlay(AudioFile=path, Boolean=Toggle(True))
audiowave = AudioWave(AudioFile=path, XOffset=number_slider, Skip=Slider(5000, range=0..5000))  # -> Peak, Points, Length
intcrv = Interpolate(Vertices=audiowave.Points, Degree=3, Periodic=False, KnotStyle=1)  # -> Curve, Length, Domain

# ----
# Divide waveform and loft as a surface
number_slider_2 = Slider(36, range=0..100)
dom = ConstructDomain(DomainStart=0, DomainEnd=expr("x-1", number_slider_2))
range = Range(Domain=dom, Steps=expr("x-1", number_slider_2))
divide_list = DivideList(List=audiowave.Points, Number=number_slider_2)  # -> Chunk, Remainder
vec = VectorXYZ(XComponent=expr("(x*-1)+0.01", graft(0)), YComponent=graft(range), ZComponent=0)  # -> Vector, Length
intcrv_2 = Interpolate(Vertices=divide_list.Chunk, Degree=3, Periodic=False, KnotStyle=1)  # -> Curve, Length, Domain
move = Move(Geometry=intcrv_2.Curve, Motion=vec.Vector)  # -> Geometry, Transform
movetoplane = MoveToPlane(Geometry=move.Geometry, Plane=PlaneYZ(0, 0, 0), Above=True, Below=True)  # -> Geometry, Transform
crv = Curve(movetoplane.Geometry)
loft = Loft(Curves=flatten(crv), Options={Adjust=False, Closed=False, LoftEnds=0, LoftSimp=0, LoftType=0, Rebuild=10, Refit=0.01})

# ----
# Divide surface into contours and extrude
number_slider_3 = Slider(12, range=0..20)
scale_nu = ScaleNU(Geometry=loft, Plane=PlaneXY(0, 0, 0), ScaleX=1, ScaleY=1, ScaleZ=number_slider_3)  # -> Geometry, Transform
contour = Contour(
    Shape=scale_nu.Geometry,
    Point=Point(0, 0.0006274138079, -0.0006274138079),
    Direction=Vector(0, 45.00062741, -0.0006274138079),
    Distance=Slider(0.2, range=0..1))
vec_2 = VectorXYZ(XComponent=0, YComponent=Slider(0.1, range=0..1), ZComponent=0)  # -> Vector, Length
extr = Extrude(Base=contour, Direction=vec_2.Vector)
vec_3 = VectorXYZ(XComponent=0, YComponent=0, ZComponent=Slider(0.4, range=0..1))  # -> Vector, Length
vdis = VectorDisplay(Anchor=Point(0, 0.0006274138079, -0.0006274138079), Vector=vec_2.Vector)
extr_2 = Extrude(Base=extr, Direction=vec_3.Vector)

extr_3 = Extrude(Base=scale_nu.Geometry, Direction=vec_3.Vector)
