# Grasshopper definition fabform.gh (Grasshopper 1.0.7)
# plug-ins: EdiTree

panel = Panel("Arrange slices")
brep = Brep([<brep referenced from the Rhino model> x105])
viewer = ParamViewer(brep)
lng = ListLength(List=viewer)
multiplication = Multiplication(A=lng, B=Slider(12, range=0..100))
dom = ConstructDomain(DomainStart=0, DomainEnd=multiplication)
range = Range(Domain=dom, Steps=lng)
pt = ConstructPoint(XCoordinate=0, YCoordinate=graft(range), ZCoordinate=0)
vec = VectorXYZ(XComponent=0, YComponent=graft(range), ZComponent=0)  # -> Vector, Length
move = Move(Geometry=brep, Motion=vec.Vector)  # -> Geometry, Transform
pl = ConstructPlane(Origin=pt, XAxis=Vector(0, 1, 0), YAxis=Vector(0, 0, 1))
rotate = Rotate(Geometry=move.Geometry, Angle=degrees(90), Plane=pl)  # -> Geometry, Transform
movetoplane = MoveToPlane(Geometry=rotate.Geometry, Plane=PlaneXY(0, 0, 0), Above=True, Below=True)  # -> Geometry, Transform
project = Project(Geometry=movetoplane.Geometry, Plane=PlaneXY(0, 0, 0))  # -> Geometry, Transform
debrep = DeconstructBrep(Brep=project.Geometry)  # -> Faces, Edges, Vertices
crv = Curve(debrep.Edges)

# ----
# Layout slices on stock
number_slider = Slider(48, range=0..100)
Y = UnitY(Factor=Slider(10, range=-36..36))
integer_division = IntegerDivision(A=lng, B=Slider(7, range=0..100))
move_2 = Move(Geometry=crv, Motion=Y)  # -> Geometry, Transform
rectangle = Rectangle(Plane=PlaneXY(0, 0, 0), XSize=number_slider, YSize=Slider(96, range=0..100), Radius=0)  # -> Rectangle, Length
divide_list = DivideList(List=move_2.Geometry, Number=integer_division)  # -> Chunk, Remainder
